# Grasshopper definition teste.gh (Grasshopper 0.9.76)
# plug-ins: Python Interpreter

python_script = PythonScript(
    Nx=Slider(5, range=0..10),
    Dx=Slider(5, range=0..20),
    Ny=Slider(2, range=0..10),
    Dy=Slider(5, range=0..20),
    Nz=Slider(4, range=0..10),
    Dz=Slider(5, range=0..20))  # -> out, a, b; inputs Nx: Int32, Ny: Int32, Nz: Int32
# ---------- python_script: Python ----------
import rhinoscriptsyntax as rs

a =[]
b =[]


# Definição da função com o Número de nós Npts e índice dos nós (tags) I
Npts = (Nx)*(Ny)*(Nz)
for I in range(0, Npts, 1):
    b.append(I)
    a.append(rs.AddPoint( (I % Nx)*(Dx/2), # coordenada X
                          ((I % (Nx*Ny))//Nx)*(Dy), # Coordenada y
                        ((I // (Nx*Ny)) + 1)*Dz)) # coordenada Z

#for v in range(
# ---------- end python_script ----------
python_script_2 = PythonScript(
    Nx=Slider(4, range=0..10),
    Dx=Slider(5, range=0..20),
    Ny=Slider(2, range=0..10),
    Dy=Slider(5, range=0..20),
    Nz=Slider(4, range=0..10),
    Dz=Slider(5, range=0..20))  # -> out, nodeCoord, nodeTag; inputs Nx: Int32, Ny: Int32, Nz: Int32
# ---------- python_script_2: Python ----------
import rhinoscriptsyntax as rs

nodeCoord =[]
nodeTag =[]

def node(i, x, y, z):
    nodeTag.append(i)
    nodeCoord.append(rs.AddPoint([x,y,z]))


Nx=Nx*2 +1
Ny=Ny*2 +1


Dx  = Dx*0.5
Dy  = Dy*0.5


# Definição da função com o Número de nós Npts e índice dos nós (tags) I
Npts = (Nx)*(Ny)*(Nz)
for I in range(0, Npts, 1):
    node(I, (I % Nx)*(Dx), ((I % (Nx*Ny))//Nx)*(Dy), ((I // (Nx*Ny)) + 1)*Dz)
# ---------- end python_script_2 ----------
text_tag_3d = TextTag3D(Location=python_script.a, Text=python_script.b, Size=Slider(1, range=0..10), Justification=7)
text_tag_3d_2 = TextTag3D(Location=python_script_2.nodeCoord, Text=python_script_2.nodeTag, Size=Slider(1, range=0..10), Justification=7)
